# Grasshopper definition Germany_Hamburg_Final.gh (Grasshopper 1.0.7)
# Copyright: RHDHV 2021

# ----
# Download links for the data: citygml = https://daten-hamburg.de/geographie_geologie_geobasisdaten/3d_stadtmodell_lod2/LoD2-DE_HH_2017-12-31.zip"
# 
# xyz = "https://daten-hamburg.de/geographie_geologie_geobasisdaten/Digitales_Hoehenmodell/DGM1/dgm1_hh_2022-04-30.zip"
number_slider = Slider(300, range=0..1000)
# Bounds of area of study
number_slider_2 = Slider(563988.538, range=0..1000000)

number_slider_3 = Slider(5933795.891, range=0..10000000)

# ----
# HESSEN open-data toolkit v0.1
# gabriel.garcia@rhdhv.com
# Sorting through all GML and xyz files to find the correct ones
selection_of_building_citygml = FilePath(["C:\Users\Lars\Documents\SynthesisProject\LOD2\LoD2_32_466_5974_1_HH.xml", "C:\Users\Lars\Documents\SynthesisProject\LOD2\LoD2_32_467_5974_1_HH.xml", "C:\Users\Lars\Documents\SynthesisProject\LOD2\LoD2_32_467_5975_1_HH.xml", "C:\Users\Lars\Documents\SynthesisProject\LOD2\LoD2_32_548_5935_1_HH.xml", "C:\Users\Lars\Documents\SynthesisProject\LOD2\LoD2_32_548_5936_1_HH.xml", "C:\Users\Lars\Documents\SynthesisProject\LOD2\LoD2_32_548_5937_1_HH.xml"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])
selection_of_xyz_files = FilePath("C:\Users\Lars\Documents\SynthesisProject\xyz\")
panel = Panel(selection_of_building_citygml)
citygml_filterer = CSharpScript(buildings=selection_of_building_citygml, center_x=number_slider_2, center_y=number_slider_3, radius=number_slider)  # -> out, output; inputs buildings: list of String, center_x: Double, center_y: Double, radius: Double
# ---------- citygml_filterer: C# usings ----------
using System.Xml;
using System.Xml.XPath;
# ---------- citygml_filterer: C# ----------
    var placeholder_output_list = new List<string>();
    output = null;

    foreach (var buildingpath in buildings)
    {
      XmlDocument xmlDoc = new XmlDocument();
      xmlDoc.Load(buildingpath);
      XmlNamespaceManager nsMgr = new XmlNamespaceManager(xmlDoc.NameTable);
      nsMgr.AddNamespace("gml", "http://www.opengis.net/gml");
      nsMgr.AddNamespace("bldg", "http://www.opengis.net/citygml/building/1.0");
      nsMgr.AddNamespace("core", "http://www.opengis.net/citygml/1.0");

      XPathNavigator navigator = xmlDoc.CreateNavigator();
      string envelopeXPath = "//gml:Envelope";
      XPathNodeIterator envelopeNodes = navigator.Select(envelopeXPath, nsMgr);



      while (envelopeNodes.MoveNext())
      {
        string upperCorner = envelopeNodes.Current.SelectSingleNode("./gml:upperCorner", nsMgr).Value;
        string lowerCorner = envelopeNodes.Current.SelectSingleNode("./gml:lowerCorner", nsMgr).Value;
        if (!string.IsNullOrEmpty(upperCorner) && !string.IsNullOrEmpty(lowerCorner))
        {
          string[] upperCornerValues = upperCorner.Split();
          string[] lowerCornerValues = lowerCorner.Split();

          double[] envelopeValues = new double[6];

          for (int i = 0; i < 3; i++)
          {
            envelopeValues[i] = Convert.ToDouble(upperCornerValues[i]);
            envelopeValues[i + 3] = Convert.ToDouble(lowerCornerValues[i]);
          }
          double x_min_bound = center_x - 0.5 * radius;
          double x_max_bound = center_x + 0.5 * radius;
          double y_min_bound = center_y - 0.5 * radius;
          double y_max_bound = center_y + 0.5 * radius;

          double x_min_envelope = envelopeValues[3];
          double x_max_envelope = envelopeValues[0];
          double y_min_envelope = envelopeValues[4];
          double y_max_envelope = envelopeValues[1];


          output = envelopeValues;
          bool x_overlap = (x_max_envelope >= x_min_bound) && (x_min_envelope <= x_max_bound);
          bool y_overlap = (y_max_envelope >= y_min_bound) && (y_min_envelope <= y_max_bound);

          if(x_overlap && y_overlap){
            //placeholder_output_list.Add(buildingpath.Split('\\')[buildingpath.Split('\\').Length - 1]);
            placeholder_output_list.Add(buildingpath);
          }
        }
      }
    }

    if (placeholder_output_list.Count == 0){
      //output = "No output";
    }
    else{
      output = placeholder_output_list;}
# ---------- end citygml_filterer ----------
panel_2 = Panel(selection_of_xyz_files)
citygml_matcher = GhPythonScript(building_names=citygml_filterer.output, xyz_directory=selection_of_xyz_files)  # -> out, xyz_names; inputs building_names: list
# ---------- citygml_matcher: Python ----------
__author__ = "Lars"
__version__ = "2023.09.26"

from System.IO import Directory, Path
matched_files = {}
xyz_names = []  # Initialize an empty list to collect matched .xyz files

for citygml_file in building_names:

    # Extract just the filename from the full path
    citygml_name = Path.GetFileNameWithoutExtension(citygml_file)
    
    # Extract relevant part of the CityGML filename to help in matching
    parts = citygml_name.split('_')
    match_key = "_".join(parts[1:5]).lower()
    
    # Search through each subdirectory
    for sub_dir in Directory.GetDirectories(xyz_directory):
        
        # Search for XYZ files in this subdirectory
        for xyz_file in Directory.GetFiles(sub_dir, "*.xyz"):
            xyz_name = Path.GetFileNameWithoutExtension(xyz_file)
            
            # Extract relevant part of the XYZ filename to help in matching
            xyz_parts = xyz_name.split('_')
            xyz_key = "_".join(xyz_parts[1:5]).lower()
            
            # Check if filenames match based on extracted parts
            if match_key == xyz_key:
                matched_files[citygml_file] = xyz_file
                xyz_names.append(xyz_file)  # Append the matched .xyz file to the list
                break
                
        # Break from the outer loop if a match is found
        if citygml_file in matched_files:
            break

# At this point, xyz_names will contain all the matched .xyz files
# ---------- end citygml_matcher ----------
panel_3 = Panel(citygml_filterer.output)
panel_4 = Panel(citygml_matcher.xyz_names)

dom = Domain(DomainStart=expr("-x/2", number_slider), DomainEnd=expr("x/2", number_slider))
# The above models were used for the rhino scene file, but more recent ones may be tried:
# 
# https://metaver.de/trefferanzeige?docuuid=2C1F2EEC-CF9F-4D8B-ACAC-79D8C1334D5E#detail_links
# 
# https://metaver.de/trefferanzeige?docuuid=A39B4E86-15E2-4BF7-BA82-66F9913D5640#detail_links
dom_2 = Domain(DomainStart=expr("-x/2", number_slider), DomainEnd=expr("x/2", number_slider))
pt = ConstructPoint(XCoordinate=number_slider_2, YCoordinate=number_slider_3, ZCoordinate=0)
rectangle = Rectangle(Plane=pt, XSize=dom, YSize=dom_2, Radius=0)  # -> Rectangle, Length

# ----
# Reading and generation of terrain
path = FilePath(panel_4)
python = GhPythonScript(file_path=path, LoS=Slider(2, range=0..100), region=rectangle.Rectangle)  # -> out, pts; inputs file_path: list
# ---------- python: Python ----------
__author__ = "Gabriel Garcia"
__version__ = "2023.04.21"

import rhinoscriptsyntax as rs
from math import sqrt

pts = []
for file in file_path:
    print("file")

    # Read file
    fileopen = open(file, 'r')
    xyz = fileopen.readlines()
    fileopen.close()
    # Check for input variables
    if not LoS:
        LoS = 20
    elif LoS == 0:
        LoS = 1
    else:
        LoS = LoS
    
    # Amount of points in XYZ file
    amount = len(xyz)
    for i in range(amount):
        if i % LoS == 0:
            line = xyz[i].split(" ")
            x = float(line[0])
            y = float(line[1])
            z = float(line[2])
            point = rs.AddPoint([x, y, z])
            if rs.PointInPlanarClosedCurve(point, region, rs.WorldXYPlane()) == 1:
                pts.append(point)
                if file == file_path[1]:
                    print("done")
            else:
                rs.DeleteObject(point)


print(len(pts))
# ---------- end python ----------
pdecon = Deconstruct(Point=python.pts)  # -> XComponent, YComponent, ZComponent
subtraction = Subtraction(A=pdecon.YComponent, B=number_slider_3)
subtraction_2 = Subtraction(A=pdecon.XComponent, B=number_slider_2)
pt_2 = ConstructPoint(XCoordinate=subtraction_2, YCoordinate=subtraction, ZCoordinate=pdecon.ZComponent)  # -> simplify(Point)
del = DelaunayMesh(Points=pt_2, Plane=PlaneXY(0, 0, 0))

python_2 = GhPythonScript(path=panel_3, region=rectangle.Rectangle)  # -> roofs, floors_walls, ground_defunct; inputs path: list
# ---------- python_2: Python ----------
__author__ = "Lars Huizer (adapted from Gabriel Garcia)"
__version__ = "2023.03.14"

import xml.etree.ElementTree as ET
import rhinoscriptsyntax as rs
import ghpythonlib.treehelpers as th



# Define XML schemas
namespaces = {
    'core': 'http://www.opengis.net/citygml/1.0',
    'gml': "http://www.opengis.net/gml",
    'bldg': "http://www.opengis.net/citygml/building/1.0"
}

roofs = []
walls = []
ground = []

for file in path:
# Parse XML
    tree = ET.parse(file)
    root = tree.getroot()
    
    # Initialize geometry lists

    # Loop through cityObjectMembers
    for mp in root.iter(('{%(core)s}cityObjectMember' %namespaces)):
        
        bui_r, bui_w, bui_g = [], [], []
        building_inside = False
        # GET ROOFS
        for i in mp.findall('.//{%(bldg)s}RoofSurface' %namespaces):
            faces_r = []
            for j in i.findall('.//{%(gml)s}posList' %namespaces):
                raw_points_r = j.text.split()
                temp_points_r = [rs.AddPoint(float(x), float(y), float(z)) for x, y, z in zip(*[iter(raw_points_r)]*3)]
                if building_inside:
                    faces_r.append(temp_points_r)
                    continue
                for point in temp_points_r:
                    if rs.PointInPlanarClosedCurve(point, region, rs.WorldXYPlane()):
                        building_inside = True
                        faces_r.append(temp_points_r)
            if faces_r:
                bui_r.append(faces_r)
        roofs.append(bui_r)
    
        # GET WALLS
        for i in mp.findall('.//{%(bldg)s}WallSurface' %namespaces):
            faces_w = []
            for j in i.findall('.//{%(gml)s}posList' %namespaces):
                raw_points_w = j.text.split()
                temp_points_w = [rs.AddPoint(float(x), float(y), float(z)) for x, y, z in zip(*[iter(raw_points_w)]*3)]
                if building_inside:
                    faces_w.append(temp_points_w)
                    continue
                for point in temp_points_w:
                    if rs.PointInPlanarClosedCurve(point, region, rs.WorldXYPlane()):
                        building_inside = True
                        faces_w.append(temp_points_w)
            if faces_w:
                bui_w.append(faces_w)
        walls.append(bui_w)
        
        # GET GROUND SURFACES
        for i in mp.findall('.//{%(bldg)s}GroundSurface' %namespaces):
            faces_g = []
            for j in i.findall('.//{%(gml)s}posList' %namespaces):
                raw_points_g = j.text.split()
                temp_points_g = [rs.AddPoint(float(x), float(y), float(z)) for x, y, z in zip(*[iter(raw_points_g)]*3)]
                if building_inside:
                    faces_w.append(temp_points_g) # no idea why, but this needs to be appended to w instead of g for solid geom
                    continue
                for point in temp_points_g:
                    if rs.PointInPlanarClosedCurve(point, region, rs.WorldXYPlane()):
                        building_inside = True
                        faces_g.append(temp_points_g)
            if faces_g:
                bui_g.append(faces_g)
        ground.append(bui_g)
    
# Convert lists to Grasshopper trees
roofs = th.list_to_tree(roofs)
floors_walls = th.list_to_tree(walls)
ground_defunct = th.list_to_tree(ground)
# ---------- end python_2 ----------
pdecon_2 = Deconstruct(Point=python_2.floors_walls)  # -> XComponent, YComponent, ZComponent
# Creation of roof, walls and building ground floors, origin rest
pdecon_3 = Deconstruct(Point=python_2.roofs)  # -> XComponent, YComponent, ZComponent
subtraction_3 = Subtraction(A=pdecon_2.YComponent, B=number_slider_3)
subtraction_4 = Subtraction(A=pdecon_2.XComponent, B=number_slider_2)
subtraction_5 = Subtraction(A=pdecon_3.YComponent, B=number_slider_3)
subtraction_6 = Subtraction(A=pdecon_3.XComponent, B=number_slider_2)
pt_3 = ConstructPoint(XCoordinate=subtraction_4, YCoordinate=subtraction_3, ZCoordinate=pdecon_2.ZComponent)  # -> simplify(Point)
pt_4 = ConstructPoint(XCoordinate=subtraction_6, YCoordinate=subtraction_5, ZCoordinate=pdecon_3.ZComponent)
pline = PolyLine(Vertices=pt_4, Closed=False)
pline_2 = PolyLine(Vertices=pt_3, Closed=False)
brep = Brep(pline)
brep_2 = Brep(pline_2)

mesh = Mesh(del)

# ----
# Combination and preview of buildings and terrain
entwine = Entwine(Branch00=brep, Branch01=brep_2, Branch02=mesh, FlattenInputs=True)  # -> flatten(Result)
preview = CustomPreview(Geometry=entwine, Material=ColourSwatch(SwatchColor=RGB(255, 255, 255)))
