# Grasshopper definition Italy_final.gh (Grasshopper 1.0.7)
# Copyright: RHDHV 2021

# ---- group: Levels per group
number_slider = Slider(4, range=1..10)
number_slider_2 = Slider(1, range=1..10)
number_slider_3 = Slider(10, range=1..10)
number_slider_4 = Slider(5, range=1..10)
number_slider_5 = Slider(3, range=1..10)
number_slider_6 = Slider(3, range=1..10)

# ----
# Building and terrain parameters
panel = Panel("https://epsg.io/map#srs=32632&x=393326.479024&y=4988706.393439&z=15&layer=streets")
clipping_square_radius = Panel("60")
remove_buildings_inside_this_radius = Panel("10")
# file path to buildings SHP file
toggle = BooleanToggle(False)
height_attribute_id = Panel("13")
shp_path = FilePath()
# file path to terrain XYZ file
paths_xyz_files = FilePath()

# ----
# New building geometry to insert in the city model
level_height = Slider(1, range=0..10)
building_footrprints = Curve([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])
entwine = Entwine(
    Branch00=number_slider,
    Branch01=number_slider_2,
    Branch02=number_slider_4,
    Branch03=number_slider_5,
    Branch04=number_slider_3,
    Branch05=number_slider_6,
    FlattenInputs=True)
level_height_2 = Number(level_height)
levels = Number(flatten(entwine))
parametric_building = Parametric_building(footrprints=building_footrprints, levels=levels, level_height=level_height_2)  # -> solids_2, one_solid_volume_2, facade_faces_2, single__level_volumes_2
brep = Brep(parametric_building.solids_2)

# ----
# Wind simulation
# parameters
number_slider_7 = Slider(50, range=0..100)

# ----
# Building and terrain
# geometry generation
cluster = Cluster(
    radius_remove=remove_buildings_inside_this_radius,
    radius_buildings=clipping_square_radius,
    coordinate_x="397285.289711",
    coordinate_y="4992574.736514",
    shp_path=shp_path,
    read_shp=toggle,
    height_attribute_id=height_attribute_id,
    sink_buildings_height="1",
    terrain_xyz_path=paths_xyz_files,
    los=Slider(1, range=0..100),
    building_to_insert=brep)  # -> buildings_extruded, terrain_brep_thick, terrain_brep, terrain_mesh, inserted_building
# Wind simulation
cluster_2 = Cluster_2(
    _1_create_tunnel=Toggle(False),
    _2_block_mesh=Toggle(False),
    load_mesh=Toggle(False),
    _3_snappy_hex_mesh=Toggle(False),
    _5_purge_solution=Toggle(False),
    _4_run_solution=Toggle(False),
    buildings=cluster.buildings_extruded,
    terrain_brep=cluster.terrain_brep_thick,
    new_building=cluster.inserted_building,
    end_time=Slider(300, range=0..1000),
    grid_size="2",
    write_interval=number_slider_7)
vec = Vector([Vector(-0.1441584, 0.34362956, -0.017366541), Vector(-0.28535975, 0.64537347, -0.047210542), Vector(-0.47685843, 1.0630066, -0.085753643), Vector(-0.63955962, 1.471914, -0.11533727), Vector(-0.79989515, 2.0526413, -0.15566049), Vector(-0.86737581, 2.6151597, -0.20639014)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])
vec_2 = Vector([Vector(-1e+300, -1e+300, -1e+300), Vector(-1e+300, -1e+300, -1e+300), Vector(-1e+300, -1e+300, -1e+300), Vector(-1e+300, -1e+300, -1e+300), Vector(-0.23858134, 0.28603622, -0.005032537), Vector(-0.29229879, 0.43032868, -0.011580891)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])
vec_3 = Vector([Vector(-1e+300, -1e+300, -1e+300), Vector(-1e+300, -1e+300, -1e+300), Vector(-1e+300, -1e+300, -1e+300), Vector(-1e+300, -1e+300, -1e+300), Vector(-0.23858134, 0.28603622, -0.005032537), Vector(-0.29229879, 0.43032868, -0.011580891)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])
vec_4 = Vector([Vector(-1e+300, -1e+300, -1e+300), Vector(-1e+300, -1e+300, -1e+300), Vector(-1e+300, -1e+300, -1e+300), Vector(-1e+300, -1e+300, -1e+300), Vector(-0.23858134, 0.28603622, -0.005032537), Vector(-0.29229879, 0.43032868, -0.011580891)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])

# ==== cluster Parametric_building
footrprints = ClusterInput()
level_height = ClusterInput()
levels = ClusterInput()
footrprints_2 = Curve(footrprints)
level_height_2 = Number(level_height)
levels_2 = Number(levels)

# ---- group: Building
level_height_3 = Number(level_height_2)
levels_3 = Number(levels_2)
footrprints_3 = Curve(footrprints_2)
expression = Expression(levels=levels_3, height=level_height_3, Expression="levels * height")
ma = MassAddition(Input=expression)  # -> Result, PartialResults
level_height_4 = Number(level_height_2)
Z = UnitZ(Factor=expression)
Z_2 = UnitZ(Factor=level_height_4)
levels_4 = Number(levels_2)

# ----
subtraction = Subtraction(A=ma.PartialResults, B=expression)

# ---- group: Building (continued)
Z_3 = UnitZ(Factor=subtraction)
move = Move(Geometry=footrprints_3, Motion=Z_3)  # -> Geometry, Transform
boundary = BoundarySurfaces(Edges=move.Geometry)  # -> flatten(Surfaces)
srf = Surface(move.Geometry)
arrlinear = LinearArray(Geometry=boundary, Direction=Z_2, Count=levels_4)  # -> Geometry, Transform
extr = Extrude(Base=move.Geometry, Direction=Z)
extr_2 = Extrude(Base=srf, Direction=Z)
sunion = SolidUnion(Breps=extr_2)
extr_3 = Extrude(Base=arrlinear.Geometry, Direction=Z_2)
footprints_groups = Curve(move.Geometry)
facade_faces = Brep(extr)
one_solid_volume = Brep(sunion)
single__level_volumes = Brep(extr_3)

# ----
solids = Brep(extr_2)
one_solid_volume_2 = ClusterOutput(one_solid_volume)
solids_2 = ClusterOutput(solids)
single__level_volumes_2 = ClusterOutput(single__level_volumes)
facade_faces_2 = ClusterOutput(facade_faces)

# ==== cluster Cluster
coordinate_y = ClusterInput()
# Click on the link and pick a point in Turin,
# then copy the coordinates in the fields to the right
coordinate_x = ClusterInput()
radius_buildings = ClusterInput()
shp_path = ClusterInput()
read_shp = ClusterInput()
radius_remove = ClusterInput()
coordinate_x_2 = Number(coordinate_x)
coordinate_y_2 = Number(coordinate_y)
shp_path_2 = FilePath(shp_path)
radius_buildings_2 = Number(radius_buildings)
radius_remove_2 = Number(radius_remove)
subtraction = Subtraction()
terrain_xyz_path = ClusterInput()
los = ClusterInput()
addition = Addition(A=coordinate_x_2, B=radius_buildings_2)
addition_2 = Addition(A=coordinate_y_2, B=radius_buildings_2)
subtraction_2 = Subtraction(A=coordinate_x_2, B=radius_buildings_2)
subtraction_3 = Subtraction(A=coordinate_y_2, B=radius_buildings_2)
addition_3 = Addition(A=coordinate_x_2, B=radius_remove_2)
addition_4 = Addition(A=coordinate_y_2, B=radius_remove_2)
subtraction_4 = Subtraction(A=coordinate_x_2, B=radius_remove_2)
subtraction_5 = Subtraction(A=coordinate_y_2, B=radius_remove_2)
readshapefile = ReadShapefile(shapefile=shp_path_2, Read=read_shp)  # -> Geometry, Attributes, Values
terrain_xyz_path_2 = FilePath(terrain_xyz_path)
los_2 = Integer(los)
height_attribute_id = ClusterInput()
building_to_insert = ClusterInput()
height_attribute_id_2 = Integer(height_attribute_id)
boundary = BoundarySurfaces(Edges=readshapefile.Geometry)
dom = ConstructDomain(DomainStart=subtraction_3, DomainEnd=addition_2)
dedomain = DeconstructDomain(Domain=dom)  # -> Start, End
subtraction_6 = Subtraction(A=dedomain.Start, B="30")
addition_5 = Addition(A=dedomain.End, B="30")
dom_2 = ConstructDomain(DomainStart=subtraction_6, DomainEnd=addition_5)
# creating the square domain
dom_3 = ConstructDomain(DomainStart=subtraction_2, DomainEnd=addition)
dedomain_2 = DeconstructDomain(Domain=dom_3)  # -> Start, End
subtraction_7 = Subtraction(A=dedomain_2.Start, B="30")
addition_6 = Addition(A=dedomain_2.End, B="30")
dom_4 = ConstructDomain(DomainStart=subtraction_7, DomainEnd=addition_6)
rectangle = Rectangle(Plane=PlaneXY(0, 0, 0), XSize=dom_4, YSize=dom_2, Radius=0)  # -> Rectangle, Length
crv = Curve(rectangle.Rectangle)
hessen_terrain = HESSEN_Terrain(file_path=terrain_xyz_path_2, los=los_2, region=crv)
dom_5 = ConstructDomain(DomainStart=subtraction_5, DomainEnd=addition_4)
dom_6 = ConstructDomain(DomainStart=subtraction_4, DomainEnd=addition_3)
area = Area(Geometry=boundary)  # -> Area, Centroid
item = ListItem(List=readshapefile.Values, Index=height_attribute_id_2, Wrap=True)
building_to_insert_2 = Brep(building_to_insert)
mesh = Mesh(hessen_terrain)
pdecon = Deconstruct(Point=area.Centroid)  # -> XComponent, YComponent, ZComponent
num = Number(item)
inc = Includes(Value=pdecon.XComponent, Domain=dom_3)  # -> Includes, Deviation
inc_2 = Includes(Value=pdecon.YComponent, Domain=dom)  # -> Includes, Deviation
inc_3 = Includes(Value=pdecon.XComponent, Domain=dom_6)  # -> Includes, Deviation
inc_4 = Includes(Value=pdecon.YComponent, Domain=dom_5)  # -> Includes, Deviation
preview = CustomPreview(Geometry=mesh, Material=ColourSwatch(SwatchColor=RGB(41, 84, 76)))
and = GateAnd(A=inc.Includes, B=inc_2.Includes)
and_2 = GateAnd(A=inc_3.Includes, B=inc_4.Includes)
dispatch = Dispatch(List=area.Centroid, DispatchPattern=and)  # -> ListA, ListB
meshcp = MeshClosestPoint(Point=dispatch.ListA, Mesh=mesh)  # -> Point, Index, Parameter
dispatch_2 = Dispatch(List=area.Centroid, DispatchPattern=and_2)  # -> ListA, ListB
pdecon_2 = Deconstruct(Point=meshcp.Point)  # -> XComponent, YComponent, ZComponent
bbox = BoundingBox(Content=building_to_insert_2, Plane=PlaneXY(0, 0, 0), UnionBox=True)  # -> Box, Box_2
# distance for the buildings
# to "sink" below the ground
sink_buildings_height = ClusterInput()
terrain_mesh = ClusterOutput(mesh)
cull_i = CullIndex(List=boundary, Indices=dispatch_2.ListA, Wrap=True)
# select footprints with
# centroid inside the square
item_2 = ListItem(List=cull_i, Index=dispatch.ListA, Wrap=True)
volume = Volume(Geometry=bbox.Box)  # -> Volume, Centroid
sink_buildings_height_2 = Number(sink_buildings_height)
subtraction_8 = Subtraction(A=pdecon_2.ZComponent, B=sink_buildings_height_2)
pdecon_3 = Deconstruct(Point=volume.Centroid)  # -> XComponent, YComponent, ZComponent
Z = UnitZ(Factor=subtraction_8)
subtraction_9 = Subtraction(A=coordinate_x_2, B=pdecon_3.XComponent)
subtraction_10 = Subtraction(A=coordinate_y_2, B=pdecon_3.YComponent)
move = Move(Geometry=item_2, Motion=Z)  # -> Geometry, Transform
vec = VectorXYZ(XComponent=subtraction_9, YComponent=subtraction_10, ZComponent=0)  # -> Vector, Length
addition_7 = Addition(A=num, B=sink_buildings_height_2)
faceb = FaceBoundaries(Mesh=mesh)
Z_2 = UnitZ(Factor=addition_7)
move_2 = Move(Geometry=building_to_insert_2, Motion=vec.Vector)  # -> Geometry, Transform
boundary_2 = BoundarySurfaces(Edges=faceb)
extr = Extrude(Base=move.Geometry, Direction=Z_2)
bbox_2 = BoundingBox(Content=move_2.Geometry, Plane=PlaneXY(0, 0, 0), UnionBox=True)  # -> Box, Box_2
join = BrepJoin(Breps=boundary_2)  # -> Breps, Closed
volume_2 = Volume(Geometry=bbox_2.Box)  # -> Volume, Centroid
preview_2 = CustomPreview(Geometry=extr, Material=ColourSwatch(SwatchColor=RGB(224, 219, 209)))
brep = Brep(join.Breps)
buildings_extruded = ClusterOutput(extr)
meshcp_2 = MeshClosestPoint(Point=volume_2.Centroid, Mesh=mesh)  # -> Point, Index, Parameter
pdecon_4 = Deconstruct(Point=meshcp_2.Point)  # -> XComponent, YComponent, ZComponent
Z_3 = UnitZ(Factor=pdecon_4.ZComponent)
move_3 = Move(Geometry=move_2.Geometry, Motion=Z_3)  # -> Geometry, Transform
terrain_brep = ClusterOutput(brep)
sunion = SolidUnion(Breps=move_3.Geometry)
inserted_building = ClusterOutput(sunion)
Z_4 = UnitZ(Factor="-1")
extr_2 = Extrude(Base=brep, Direction=Z_4)
terrain_brep_thick = ClusterOutput(extr_2)

# ==== cluster Cluster_2
new_building = ClusterInput()
terrain_brep = ClusterInput()
buildings = ClusterInput()
clean = CleanTree(RemoveNulls=Toggle(True), RemoveInvalid=True, RemoveEmpty=False, Tree=buildings)
flatten = FlattenTree(Tree=clean, Path="{0}")
merge = Merge(Data1=flatten, Data2=terrain_brep, Data3=new_building)
bbox = BoundingBox(Content=new_building, Plane=PlaneXY(0, 0, 0), UnionBox=True)  # -> Box, Box_2
flatten_2 = FlattenTree(Tree=merge, Path="{0}")
wall = Butterfly_WallBoundary()  # -> wall_boundary; plug-in component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
volume = Volume(Geometry=bbox.Box)  # -> Volume, Centroid
pl = ConstructPlane(Origin=volume.Centroid, XAxis=Vector(1, 0, 0), YAxis=Vector(0, 1, 0))
scale_nu = ScaleNU(Geometry=bbox.Box, Plane=pl, ScaleX="1.5", ScaleY="1.5", ScaleZ="1.5")  # -> Geometry, Transform
inoutrefmode = Butterfly_LocationRefinementMode(mode=0, level="2")  # -> location_ref_mode; plug-in component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
preview = CustomPreview(Geometry=flatten_2, Material=ColourSwatch(SwatchColor=RGB(196, 196, 196)))
jagged = SettingsSpeed()
jagged_2 = SettingsSpeed()
refinementregion = Butterfly_RefinementRegion(name="refinement", geo=flatten(scale_nu.Geometry), ref_mode=inoutrefmode, mesh_set=jagged_2)  # -> report, ref_region; plug-in component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
createbfgeometry = Butterfly_CreateButterflyGeometry(name="citymodel", geo=flatten(clean), boundary=wall, refine_levels="1,2", n_srf_layers="3", mesh_set=jagged)  # -> report, BF_geo; plug-in component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
windvector = Butterfly_WindVector(wind_speed=Slider(5, range=0..10), wind_direction=Point(0, 1, 0))  # -> wind_vector; plug-in component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
tunnelparams = Butterfly_WindTunnelParameters(windward_x="1.5", top_x="1.5", sides_x="1.5", leeward_x="1.5")  # -> report, tunnel_params; plug-in component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
_1_create_tunnel = ClusterInput()
box_corners = BoxCorners(Box=scale_nu.Geometry)  # -> CornerA, CornerB, CornerC, CornerD, CornerE, CornerF, CornerG, CornerH
createcasefromtunnel = Butterfly_CreateCaseFromTunnel(
    name="tunnel",
    BF_geo=flatten(createbfgeometry.BF_geo),
    ref_regions=refinementregion.ref_region,
    wind_vector=windvector,
    ref_wind_height=10,
    landscape=6,
    tunnel_params=tunnelparams.tunnel_params,
    run=_1_create_tunnel)  # -> report, block_pts, wind_tunnel, case; plug-in component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
pdecon = Deconstruct(Point=box_corners.CornerG)  # -> XComponent, YComponent, ZComponent
pdecon_2 = Deconstruct(Point=box_corners.CornerA)  # -> XComponent, YComponent, ZComponent
pt = Point(box_corners.CornerB)
pt_2 = Point(box_corners.CornerA)
wtgrading = Butterfly_windTunnelGrading(
    wind_tunnel=createcasefromtunnel.wind_tunnel,
    cell_size=Slider(2, range=0..10),
    cell_to_cell_ratio=1.2,
    wake_offset=2,
    height_offset=5)  # -> report, grad_xyz, cell_count_xyz, cell_count_tot, preview; plug-in component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
ln = Line(StartPoint=pt, EndPoint=pt_2)
_2_block_mesh = ClusterInput()
X = UnitX(Factor=1)
Y = UnitY(Factor=1)
subtraction = Subtraction(A=pdecon.ZComponent, B=pdecon_2.ZComponent)
subtraction_2 = Subtraction(A=pdecon.XComponent, B=pdecon_2.XComponent)
subtraction_3 = Subtraction(A=pdecon.YComponent, B=pdecon_2.YComponent)
pframes = PerpFrames(Curve=ln, Count="8", Align=True)  # -> Frames, Parameters
pl_2 = ConstructPlane(Origin=box_corners.CornerA, XAxis=X, YAxis=Y)
blockmesh = Butterfly_blockMesh(
    case=createcasefromtunnel.case,
    grad_xyz=wtgrading.grad_xyz,
    cell_count=wtgrading.cell_count_xyz,
    overwrite=True,
    write=_2_block_mesh,
    run=_2_block_mesh)  # -> report, case; plug-in component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
snappyhexmeshdict = Butterfly_snappyHexMeshDict(
    castellated_mesh=True,
    snap=True,
    add_layers=False,
    n_cells_btwn_levels=3,
    max_global_cells=2000000,
    expansion_ratio=1.1,
    final_layer_thickness=0.7,
    min_thickness=0.1,
    n_layer_iter=50)  # -> snappy_hex_mesh_dict; plug-in component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
rectangle = Rectangle(Plane=pframes.Frames, XSize=subtraction, YSize=subtraction_3, Radius=0)  # -> Rectangle, Length
rectangle_2 = Rectangle(Plane=pl_2, XSize=subtraction_2, YSize=subtraction_3, Radius=0)  # -> Rectangle, Length
_3_snappy_hex_mesh = ClusterInput()
end_time = ClusterInput()
write_interval = ClusterInput()
Z = UnitZ(Factor=1)
srf = Surface(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)
Z_2 = UnitZ(Factor=Slider(7, range=0..10))
move = Move(Geometry=rectangle_2.Rectangle, Motion=Z_2)  # -> Geometry, Transform
snappyhexmesh = Butterfly_snappyHexMesh(case=blockmesh.case, snappy_hex_mesh_dict=snappyhexmeshdict, write=_3_snappy_hex_mesh, run=_3_snappy_hex_mesh)  # -> report, case; plug-in component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
move_2 = Move(Geometry=srf, Motion=Z)  # -> Geometry, Transform
merge_2 = Merge(Data1=rectangle.Rectangle, Data2=move.Geometry)
controldict = Butterfly_controlDict(start_time=0, end_time=end_time, write_interval=write_interval, write_compression=False, purge_write=0)  # -> control_dict; plug-in component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
load_mesh = ClusterInput()
steadyincomp = Butterfly_SteadyIncompressibleRecipe()  # -> report, recipe; plug-in component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
panel = Panel(merge_2)
flatten_3 = FlattenTree(Tree=merge_2, Path="{0}")
loadmesh = Butterfly_LoadMesh(case=snappyhexmesh.case, inner_mesh=False, load=load_mesh)  # -> mesh; plug-in component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
grid_size = ClusterInput()
srf_2 = Surface(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)
trim = TrimSolid(Shape=flatten_3, Cutters=flatten_2)
genpts = LBGeneratePointGrid(geometry=trim, grid_size=grid_size)  # -> flatten(points), vectors, face_areas, graft(mesh); plug-in component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
panel_2 = Panel("""p
U""")
probes = Butterfly_probes(points=genpts.points, fields=panel_2)  # -> probes; plug-in component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
solutionparams = Butterfly_SolutionParameters(control_dict=controldict, probes=probes)  # -> solution_par; plug-in component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
_4_run_solution = ClusterInput()
mjoin = MeshJoin(Meshes=genpts.mesh)
solution = Butterfly_Solution(
    case=snappyhexmesh.case,
    recipe=steadyincomp.recipe,
    solution_par=solutionparams,
    interval=Slider(10, range=0..10),
    write=_4_run_solution,
    run=_4_run_solution)  # -> report, solution, is_running, timestep, residual_fields, residual_values, log_files; plug-in component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
_5_purge_solution = ClusterInput()
colrange = LBColorRange(index="2")  # -> colors; plug-in component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
loadprobesvalue = Butterfly_LoadProbesValue(solution=solution.solution, field="p")  # -> values; plug-in component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
purgecase = Butterfly_purgeCase(case=solution.solution, block_mesh=False, snappy_hex_mesh=False, results=_5_purge_solution, post_processing=False)  # -> report; plug-in component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
loadprobesvalue_2 = Butterfly_LoadProbesValue(solution=solution.solution, field="U")  # -> values; plug-in component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
legendpar = LBLegendParameters(colors=colrange)  # -> leg_par; plug-in component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
vec = Vector(loadprobesvalue_2)
vlen = VectorLength(Vector=vec)
bnd = Bounds(Numbers=vlen)
dedomain = DeconstructDomain(Domain=bnd)  # -> Start, End
gradient = Gradient(
    LowerLimit="10",
    UpperLimit=dedomain.Start,
    Parameter=vlen,
    stops=[0: RGB(234, 38, 0), 0.25: RGB(234, 126, 0), 0.5: RGB(254, 244, 84), 0.75: RGB(173, 203, 249), 1: RGB(75, 107, 169)])
panel_3 = Panel(purgecase)
heatmap = LBSpatialHeatmap(values=loadprobesvalue, mesh=mjoin, legend_par=legendpar)  # -> mesh, legend, title, colors, legend_par, vis_set; plug-in component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
devec = DeconstructVector(Vector=vec)  # -> XComponent, YComponent, ZComponent
unit = UnitVector(Vector=vec)
vdisex = VectorDisplayEx(Point=genpts.points, Vector=unit, Colour=gradient, Width=2)
vectors = ClusterOutput(vec)

# ==== cluster HESSEN_Terrain: Transform GML files into GH geometries and data
file_path = ClusterInput()
los = ClusterInput()
region = ClusterInput()
py_pointsfromxyzfile = GhPythonScript(file_path=file_path, LoS=los, region=region)  # -> out, pts
# ---------- py_pointsfromxyzfile: Python ----------
__author__ = "Gabriel Garcia"
__version__ = "2023.04.21"

import rhinoscriptsyntax as rs
from math import sqrt

if file_path:
    # Read file
    file = open(file_path, 'r')
    xyz = file.readlines()
    file.close()
    
    # Check for input variables
    if not LoS:
        LoS = 20
    elif LoS == 0:
        LoS = 1
    else:
        LoS = LoS
    
    # Amount of points in XYZ file
    
    amount = 250000
    row = sqrt(amount)
    
    # Get indexes
    width = row / LoS
    x = LoS * LoS * width
    
    indexes = []
    for i in range(amount):
        if i % x == 0:
            for j in range(int(row/LoS)):
                indexes.append(int(i + (j*LoS)))
    
    # Create points based on indexes
    pts = []
    n = 0
    for i in indexes:
        line = xyz[i].split(" ")
        list = []
        for i in line:
            if i:
                list.append(i)
        x = float(list[0])
        y = float(list[1])
        z = float(list[2])
        point  = rs.AddPoint([x,y,z])
        if region:
            if rs.PointInPlanarClosedCurve(point,region,rs.WorldXYPlane()) == 1:
                pts.append(point)
        else:
            pts.append(point)
# ---------- end py_pointsfromxyzfile ----------
releaseinfo = ReleaseInfo(
    Name="HESSEN_Terrain",
    Scope="Open-data toolkits",
    Description="Transform GML files into GH geometries and data",
    Release="0",
    Version="1")  # inputs Name: String, Scope: String, Description: String, Release: Int32, Version: Int32
# ---------- releaseinfo: C# usings ----------
using Grasshopper.Kernel.Special;
# ---------- releaseinfo: C# ----------
    GH_Document thisDoc = this.Component.OnPingDocument();
    IGH_DocumentOwner parentDoc = thisDoc.Owner;
    GH_Cluster clusterComponent = (GH_Cluster) parentDoc;

    if (clusterComponent == null){
      this.Component.AddRuntimeMessage(GH_RuntimeMessageLevel.Warning, "This component only works within a cluster component");
      return;
    }

    this.Component.Params.Input[0].Description = "Name and nickname of the cluster component";
    this.Component.Params.Input[1].Description = "Scope of the cluster component, included as header of the message. Describes the package this cluster is part of.";
    this.Component.Params.Input[2].Description = "Description of the functionality of this cluster component";
    this.Component.Params.Input[3].Description = "Main release of this package";
    this.Component.Params.Input[4].Description = "Sub version of this cluster component";

    clusterComponent.Name = Name;
    clusterComponent.NickName = Name;
    clusterComponent.Description = Description;
    clusterComponent.Message = String.Format("{0}\n{3}\nVersion {1}.{2:00}", Scope, Release, Version, Name);
# ---------- end releaseinfo ----------
del = DelaunayMesh(Points=py_pointsfromxyzfile.pts, Plane=PlaneXY(0, 0, 0))
terrain_mesh = Mesh(del)
terrain_mesh_2 = ClusterOutput(terrain_mesh)
