# Grasshopper definition UK_final_1115.gh (Grasshopper 1.0.7)

# ---- group: Solar analysis
Z = UnitZ(Factor=1)  # disabled
mesh = Mesh()  # disabled
pt = Point()  # disabled
number_slider = Slider(2, range=0..100)  # disabled
number_slider_2 = Slider(3, range=0..10)  # disabled
epw_url = Panel("https://climate.onebuilding.org/WMO_Region_6_Europe/GBR_United_Kingdom/ENG_England/GBR_ENG_London.Wea.Ctr-St.James.Park.037700_TMYx.zip")  # disabled
day = Panel("21")  # disabled
month = Panel("6")  # disabled
project = ProjectPoint(Point=pt, Direction=Z, Geometry=mesh)  # -> Point, Index; disabled
geo = Geometry()  # disabled
cluster = Cluster(
    start_month=month,
    start_day=day,
    end_month=month,
    end_day=day,
    center_pt=project.Point,
    context=geo,
    grid_size=number_slider_2,
    offset_dist=number_slider,
    weather_url=epw_url)  # disabled

# ----
source_x = Slider(-0.0837, range=-6.236..2.072)
source_y = Slider(51.51316, range=49.943..55.816)
source_y_2 = Panel("45.07918")
source_x_2 = Panel("-0.08370")
source_y_3 = Panel("51.51316")
sourcesrs = Panel("WGS84")
destsrs = Panel("EPSG:32632")
source_x_3 = Panel("7.694968")
destsrs_2 = Panel("EPSG:27700")
panel = Panel("533072.29565")
panel_2 = Panel("181099.82913")
panel_3 = Panel("397285.289711")
panel_4 = Panel("4992574.736514")

# ---- group: Building meshed points control
# Load shapefile here
max_edge = Slider(4, range=1..50)
# Required packages
# The following packages are needed to run the CDT_TIN_Modelling tool:
# 1. Heron 0.4.1 or above, which is required for coordinate transformation
# 2. Local Software 1.0.133 or above, which is require to import SHP file.
#     This package can be downloaded at  "https://www.food4rhino.com/en/app/local-software"
# This tool is only limited for the UK case.
# The input data of Italy need further processing to be compatibale with CDT-method.
# Building and terrain parameters
min_edge = Slider(2, range=1..10)

# ---- group: Bbox_setup
# Adjust the bbox size here
# Manual:
# - The CDT_TIN_modelling is built for generating watertight model from the building and terrain input layers.
# - The format of building is limited to shapefile while the terrain is limited to XYZ file.
# 1. Max & Min edges
#     Control of the length between each meshed points in every building footprints. Notice that changing the min and max might also change the meshed shapes of building footprints
# 2. Building
#     2.1 SHP: Select the path of the downloaded SHP building file.
#     2.2 Toggle: Switch to "True" to load the SHP file.
#     2.3 height attribute id: Enter the column number of which the height information is stored.
# 3. Terrain
#     3.1 terrain_path: Select the path of the existing XYZ terrain file. If only Geotiffs are available on the portal, check the report appendix A for the Python code to do the XYZ coversion.
#     3.2 LoS: Level of simplification, which is used for thinning the input terrain point set and generating the indices for selecting the terrain points
# 4. Bounding box(Bbox) setting
#     4.1 source_X: The X value of the desired POI
#     4.2 source_Y: The Y value of the desired POI
#     4.3 sourceSRS: The original data's CRS, default is set to WGS84
#     4.4 destSRS: The desinated CRS. For instance, the EPSG:27700 is the local CRS for the data in the UK.
#     4.5 bbox size: Adjust the desired size of the bounding box extent. Notice that this value should not exceed the maximum extent of the imported building or terrain files.
bbox_size = Slider(200, range=0..1500)
source_y_4 = Panel("51.51316")
# Enter your point of intereset
#  (POI's XY values) here
source_x_4 = Panel("-0.08370")
sourcesrs_3 = Panel("WGS84")
destsrs_3 = Panel("EPSG:27700")
poi_srs_transform = POI_SRS_transform(X=source_x_4, Y=source_y_4, sourcesrs=sourcesrs_3, destsrs=destsrs_3)  # -> local_x, local_y

# ---- group: Terrain_input
# Load XYZ here
terrain_path = FilePath("C:\Users\cooki\OneDrive\桌面\Python_synthesis\Python_synthesis\python\data\Terrain\LIDAR-DTM-1m-2022-TQ38sw\roi.xyz")
number_slider_3 = Slider(40, range=0..100)

# ---- group: Building_input
toggle = BooleanToggle(True)
height_attribute_id = Panel("1")
shp_path = FilePath("C:\Users\cooki\OneDrive\桌面\Python_synthesis\Python_synthesis\python\data\Buildings\QGIS\building_footprint.shp")

# ----
# CDT_Building and terrain
# geometry generation
cdt_tin_modelling = CDT_TIN_modelling(
    min_edge=min_edge,
    max_edge=max_edge,
    shapefile=shp_path,
    read=toggle,
    height_attribute_id=height_attribute_id,
    dtm_file_path=terrain_path,
    los=number_slider_3,
    X=poi_srs_transform.local_x,
    Y=poi_srs_transform.local_y,
    A=bbox_size)  # -> building_mesh_2, terrain_mesh_2
preview = CustomPreview(Geometry=cdt_tin_modelling.building_mesh_2, Material=ColourSwatch(SwatchColor=RGB(230, 230, 230)))
preview_2 = CustomPreview(Geometry=cdt_tin_modelling.terrain_mesh_2, Material=ColourSwatch(SwatchColor=RGB(3, 57, 76)))

# ==== cluster Cluster
offset_dist = ClusterInput()
geometry = ClusterInput()
grid_size = ClusterInput()
context = ClusterInput()
start_month = ClusterInput()
start_day = ClusterInput()
end_month = ClusterInput()
end_day = ClusterInput()
center_pt = ClusterInput()
weather_url = ClusterInput()

# ---- group: location
downloadepw = LBDownloadWeather(weather_URL=weather_url)  # -> epw_file, stat_file, ddy_file; plug-in component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
importepw = LBImportEPW(epw_file=downloadepw.epw_file)  # -> location, dry_bulb_temperature, dew_point_temperature, relative_humidity, wind_speed, wind_direction, direct_normal_rad, diffuse_horizontal_rad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; plug-in component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
importloc = LBImportLocation(epw_file=downloadepw.epw_file)  # -> location; plug-in component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

# ---- group: day
analysisperiod = LBAnalysisPeriod(start_month=start_month, start_day=start_day, start_hour=0, end_month=end_month, end_day=end_day)  # -> period, hoys, dates; plug-in component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

# ---- group: sunhours
sunpath = LBSunPath(location=importloc, hoys=analysisperiod.hoys, center_pt=center_pt, scale=1)  # -> report, vectors, altitudes, azimuths, hoys, sun_pts, analemma, daily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; plug-in component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
directsunhours = LBDirectSunHours(
    vectors=flatten(sunpath.vectors),
    geometry=flatten(geometry),
    context=flatten(context),
    grid_size=grid_size,
    offset_dist=offset_dist,
    run=Toggle(True))  # -> report, points, results, mesh, legend, title, int_mtx; plug-in component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

# ---- group: irradiation
skymatrix = LBCumulativeSkyMatrix(
    location=importloc,
    direct_rad=importepw.direct_normal_rad,
    diffuse_rad=importepw.diffuse_horizontal_rad,
    hoys=analysisperiod.hoys)  # -> report, sky_mtx; plug-in component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
incidentradiation = LBIncidentRadiation(
    sky_mtx=skymatrix.sky_mtx,
    geometry=flatten(geometry),
    context=flatten(context),
    grid_size=grid_size,
    offset_dist=offset_dist,
    run=Toggle(True))  # -> report, points, results, total, mesh, legend, title, int_mtx; plug-in component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

# ----
pt = Point(directsunhours.points)
panel = Panel(incidentradiation.legend)

# ==== cluster CDT_TIN_modelling
dtm_file_path = ClusterInput()
A = ClusterInput()
X = ClusterInput()
Y = ClusterInput()
los = ClusterInput()
min_edge = ClusterInput()
max_edge = ClusterInput()
shapefile = ClusterInput()
height_attribute_id = ClusterInput()
read = ClusterInput()

# ---- group: Building_SHP_read
readshapefile = ReadShapefile(shapefile=shapefile, Read=read)  # -> Geometry, Attributes, Values
item = ListItem(List=readshapefile.Values, Height_attribute_id=height_attribute_id, Wrap=True)
boundary = BoundarySurfaces(Edges=readshapefile.Geometry)
heights = Number(item)
Z = UnitZ(Factor=heights)
extr = Extrude(Base=boundary, Direction=Z)
preview = CustomPreview(Geometry=extr, Material=ColourSwatch(SwatchColor=RGB(255, 153, 153)))

# ----
building_crv = Curve(simplify(readshapefile.Geometry))

# ---- group: bbox
dom = Domain(DomainStart=expr("-x/2", A), DomainEnd=expr("x/2", A))
pt = ConstructPoint(XCoordinate=X, YCoordinate=Y, ZCoordinate=0)
dom_2 = Domain(DomainStart=expr("-x/2", A), DomainEnd=expr("x/2", A))
rectangle = Rectangle(Plane=pt, XSize=dom, YSize=dom_2, Radius=0)  # -> Rectangle, Length

# ---- group: Terrain_XYZ_read
py_pointsfromxyzfile = GhPythonScript(dtm_file_path=dtm_file_path, LoS=los, region=rectangle.Rectangle)  # -> out, dtm_pts_3d
# ---------- py_pointsfromxyzfile: Python ----------
__author__ = "Gabriel Garcia"
__version__ = "2023.04.21"

import rhinoscriptsyntax as rs
from math import sqrt

if dtm_file_path:
    # Read file
    file = open(dtm_file_path, 'r')
    xyz = file.readlines()
    file.close()
    
    # Check for input variables
    if not LoS:
        LoS = 20
    elif LoS == 0:
        LoS = 1
    else:
        LoS = LoS
    
    # Amount of points in XYZ file
    
    amount = 1000000
    row = sqrt(amount)
    
    # Get indexes
    width = row / LoS
    x = LoS * LoS * width
    
    indexes = []
    for i in range(amount):
        if i % x == 0:
            for j in range(int(row/LoS)):
                indexes.append(int(i + (j*LoS)))
    
    # Create points based on indexes
    dtm_pts_3d = []
    n = 0
    for i in indexes:
        line = xyz[i].split(" ")
        list = []
        for i in line:
            if i:
                list.append(i)
        x = float(list[0])
        y = float(list[1])
        z = float(list[2])
        point  = rs.AddPoint([x,y,z])
        if region:
            if rs.PointInPlanarClosedCurve(point,region,rs.WorldXYPlane()) == 1:
                dtm_pts_3d.append(point)
        else:
            dtm_pts_3d.append(point)
# ---------- end py_pointsfromxyzfile ----------
del = DelaunayMesh(Points=py_pointsfromxyzfile.dtm_pts_3d, Plane=PlaneXY(0, 0, 0))
preview_2 = CustomPreview(Geometry=del, Material=ColourSwatch(SwatchColor=RGB(135, 135, 135)))

# ---- group: bbox (continued)
project = Project(Geometry=del, Plane=rectangle.Rectangle)  # -> Geometry, Transform
bbox = BoundingBox(Content=project.Geometry, Plane=PlaneXY(0, 0, 0))  # -> Box, Box_2
debrep = DeconstructBrep(Brep=bbox.Box)  # -> Faces, Edges, Vertices
boundary_2 = BoundarySurfaces(Edges=debrep.Edges)
bbox_crv = Curve(boundary_2)

# ---- group: Building_footprints_mesh
custom_mesh_settings = SettingsCustom(
    StitchSeams=True,
    SimplePlanes=False,
    Refine=True,
    MinCount=16,
    MaxCount=400,
    AspectRatio=20,
    MaxDistance=0,
    MaxAngle=20,
    MinEdge=min_edge,
    MaxEdge=max_edge)
project_2 = Project(Geometry=bbox.Box, Plane=boundary)  # -> Geometry, Transform
mesh = MeshBrep(Brep=boundary, Settings=custom_mesh_settings)
demesh = DeconstructMesh(Mesh=mesh)  # -> flatten(Vertices), Faces, Colours, Normals
b_constraint_pts = SplitWithBreps(Curve=project_2.Geometry, Brep=boundary)  # -> Curve, Points
merge = Merge(Data1=demesh.Vertices, Data2=b_constraint_pts.Points)  # -> flatten(Result)
incurves = PointInCurves(Point=merge, Curves=bbox_crv)  # -> Relationship, Index, Point
bool = Boolean(incurves.Relationship)
dispatch = Dispatch(List=merge, DispatchPattern=bool)  # -> ListA, ListB
building_pts = Point(dispatch.ListA)

# ----
merge_2 = Merge(Data1=building_pts, Data2=debrep.Vertices)  # -> flatten(Result)
projptterrain = ProjectPtOntoTerrain(TerrainMesh=del, Point=merge_2)
all_dtm_pts = Point(py_pointsfromxyzfile.dtm_pts_3d)

# ---- group: Average_building_pts_z and assign back
merge_3 = Merge(Data1=projptterrain, Data2=all_dtm_pts)
incurves_2 = PointInCurves(Point=all_dtm_pts, Curves=flatten(building_crv))  # -> Relationship, Index, Point
incurves_3 = PointInCurves(Point=merge_3, Curves=building_crv)  # -> Relationship, Index, Point
dispatch_2 = Dispatch(List=all_dtm_pts, DispatchPattern=incurves_2.Relationship)  # -> ListA, ListB
dispatch_3 = Dispatch(List=merge_3, DispatchPattern=incurves_3.Relationship)  # -> ListA, ListB
py_assign_z_avg = GhPythonScript(x=dispatch_3.ListA)  # -> out, flatten(b_pts); inputs x: list
# ---------- py_assign_z_avg: Python ----------
__author__ = "bstsai"
__version__ = "2023.11.01"

import rhinoscriptsyntax as rs
b_pts = []
z_val = []
if len(x) != 0:
    # calculate the z_avg of all points in each building footprints
    for pt in x:
        pt = rs.coerce3dpoint(pt)
        z = pt[2]
        z_val.append(z)
    z_sum = sum(z_val)
    z_num = len(z_val)
    z_avg = z_sum/z_num
    
    # assign z_avg to all the building footprint points
    for pt in x:
        pt = rs.coerce3dpoint(pt)
        x = pt[0]
        y = pt[1]
        z = z_avg
        point = rs.AddPoint([x,y,z])
        b_pts.append(point)
        
#for i in b_pts:
#    i = rs.coerce3dpoint(i)
#    print(i)
# ---------- end py_assign_z_avg ----------
dtm_pts = Point(dispatch_2.ListB)
merge_4 = Merge(Data1=py_assign_z_avg.b_pts, Data2=dtm_pts)  # -> flatten(Result)

# ----
del_2 = DelaunayMesh(Points=merge_4, Plane=PlaneXY(0, 0, 0))

# ---- group: Cull out null triangles
demesh_2 = DeconstructMesh(Mesh=del_2)  # -> Vertices, Faces, Colours, Normals
deface = DeconstructFace(Face=demesh_2.Faces)  # -> CornerA, CornerB, CornerC, CornerD
item_2 = ListItem(List=demesh_2.Vertices, Index=deface.CornerA, Wrap=True)
item_3 = ListItem(List=demesh_2.Vertices, Index=deface.CornerB, Wrap=True)
item_4 = ListItem(List=demesh_2.Vertices, Index=deface.CornerC, Wrap=True)
srf4pt = _4PointSurface(CornerA=item_2, CornerB=item_3, CornerC=item_4)
null = NullItem(Item=srf4pt)  # -> NullFlags, InvalidFlags, Description
dispatch_4 = Dispatch(List=srf4pt, DispatchPattern=null.NullFlags)  # -> ListA, ListB
debrep_2 = DeconstructBrep(Brep=dispatch_4.ListB)  # -> Faces, Edges, Vertices

# ----
del_3 = DelaunayMesh(Points=debrep_2.Vertices, Plane=PlaneXY(0, 0, 0))

# ---- group: Building_triangles_selection
building_curves = ListItem(List=building_crv, Index=0, Wrap=True)
facen = FaceNormals(Mesh=del_3)  # -> Centers, Normals
clean = CleanTree(RemoveNulls=True, RemoveInvalid=True, RemoveEmpty=False, Tree=del_3)
incurve = PointInCurve(Point=flatten(facen.Centers), Curve=building_curves)  # -> Relationship, Point
py_triangles_in_b = GhPythonScript(eval=incurve.Relationship, triang=flatten(clean))  # -> out, triang_out; inputs eval: list, triang: list
# ---------- py_triangles_in_b: Python ----------
triang_out = []
for n,e in enumerate(eval):
    if e == 2 or e == 1:
        triang_out.append(triang[n])
# ---------- end py_triangles_in_b ----------
demesh_3 = DeconstructMesh(Mesh=py_triangles_in_b.triang_out)  # -> Vertices, Faces, Colours, Normals

# ---- group: CDT_Mesh_view
demesh_4 = DeconstructMesh(Mesh=clean)  # -> simplify(Vertices), simplify(Faces), Colours, Normals
deface_2 = DeconstructFace(Face=demesh_4.Faces)  # -> CornerA, CornerB, CornerC, CornerD
item_5 = ListItem(List=demesh_4.Vertices, Index=deface_2.CornerB, Wrap=True)
item_6 = ListItem(List=demesh_4.Vertices, Index=deface_2.CornerA, Wrap=True)
item_7 = ListItem(List=demesh_4.Vertices, Index=deface_2.CornerC, Wrap=True)
srf4pt_2 = _4PointSurface(CornerA=item_6, CornerB=item_5, CornerC=item_7)
preview_3 = CustomPreview(Geometry=srf4pt_2, Material=ColourSwatch(SwatchColor=RGB(135, 135, 135)))

# ---- group: Get flat CDT footprints for extrusion
trim = TrimTree(Tree=demesh_3.Vertices, Depth=1)
pdecon = Deconstruct(Point=trim)  # -> XComponent, YComponent, ZComponent
minimum = GhPythonScript(val=pdecon.ZComponent)  # -> out, min_z, avg_z, diff_z; inputs val: list
# ---------- minimum: Python ----------
__author__ = "bstsai"
__version__ = "2023.11.01"

import rhinoscriptsyntax as rs

list_z = []
for i in range(len(val)):
    a = float(val[i])
    list_z.append(a)
if len(list_z) != 0:
    min_z = min(list_z)
    sum_z = sum(list_z)
    avg_z = sum_z / len(list_z)
    diff_z = avg_z-min_z
    print(diff_z)
#    print(min_z)
# ---------- end minimum ----------
avr = Average(Input=pdecon.XComponent)
avr_2 = Average(Input=pdecon.YComponent)
pt_2 = ConstructPoint(XCoordinate=avr, YCoordinate=avr_2, ZCoordinate=minimum.min_z)
pln = Plane(pt_2)

# ---- group: Buildings_triangles
item_8 = ListItem(List=demesh_3.Vertices, Index=0, Wrap=True)  # -> Item, Item1, Item2
srf4pt_3 = _4PointSurface(CornerA=item_8.Item, CornerB=item_8.Item1, CornerC=item_8.Item2)
trim_2 = TrimTree(Tree=srf4pt_3, Depth=1)
project_3 = Project(Geometry=trim_2, Plane=pln)  # -> Geometry, Transform

# ---- group: Extrude_height
heights_2 = Number(heights)
addition = Addition(A=minimum.diff_z, B=heights_2)
Z_2 = UnitZ(Factor=addition)

# ----
extr_2 = Extrude(Base=simplify(project_3.Geometry), Direction=simplify(Z_2))
terrain_mesh = Mesh(clean)
buildings_mesh = MeshBrep(
    Brep=extr_2,
    Settings={GridMaxCount=0, GridMinCount=16, JaggedSeams=False, MaxEdgeLength=0, MinEdgeLength=0.0001, MinTolerance=0, Refine=True, RefineAngle=0, RelativeTolerance=0.65, SimplePlanes=True, Tolerance=0})
building_mesh = Mesh(buildings_mesh)
preview_4 = CustomPreview(Geometry=buildings_mesh, Material=ColourSwatch(SwatchColor=RGB(178, 178, 178)))
preview_5 = CustomPreview(Geometry=terrain_mesh, Material=ColourSwatch(SwatchColor=RGB(3, 57, 76)))
building_mesh_2 = ClusterOutput(building_mesh)
terrain_mesh_2 = ClusterOutput(terrain_mesh)

# ==== cluster POI_SRS_transform
sourcesrs = ClusterInput()
destsrs = ClusterInput()
X = ClusterInput()
Y = ClusterInput()
pt = ConstructPoint(XCoordinate=X, YCoordinate=Y, ZCoordinate=0)
ct = CoordinateTransformation(SourcePoints=pt, SourceSRS=sourcesrs, DestinationSRS=destsrs)
pdecon = Deconstruct(Point=ct)  # -> XComponent, YComponent, ZComponent
local_x = ClusterOutput(pdecon.XComponent)
local_y = ClusterOutput(pdecon.YComponent)
