# Grasshopper definition hk_final.gh (Grasshopper 1.0.7)

panel = Panel("https://portal.csdi.gov.hk/server/services/common/landsd_rcd_1637222178637_54848/mapserver/wfsserver?service=wfs&request=getfeature&typename=esri:tilename&outputformat=geojson")  # disabled
panel_2 = Panel("./temp_files")  # disabled
panel_3 = Panel("114.170000")  # disabled
panel_4 = Panel("22.296000")  # disabled
panel_5 = Panel("2")  # disabled
geo = Geometry(<brep referenced from the Rhino model>)  # disabled
panel_6 = Panel("300")  # disabled
panel_7 = Panel("250")  # disabled
panel_8 = Panel("10")  # disabled
panel_9 = Panel("5")  # disabled

# ---- group: ContextAcquisition
c_contextacquisition = C_ContextAcquisition(url_geojson=panel, pos_center_x=panel_3, pos_center_y=panel_4, radius_bbox=panel_8, temp_dir=panel_2)  # -> tile_count, context; disabled
panel_10 = Panel(c_contextacquisition.tile_count)  # disabled

# ---- group: BuildingAcquistion
c_buildingcreation = C_BuildingCreation(building=geo, movement_x=panel_7, movement_y=panel_6, movement_z=panel_9)  # disabled

# ----
geo_2 = Geometry([<mesh referenced from the Rhino model>, <brep referenced from the Rhino model> x11])  # disabled
mesh = Mesh(geo_2)  # disabled
mjoin = MeshJoin(Meshes=mesh)  # disabled

# ---- group: DataAlignment
c_voxelcontext = C_VoxelContext(context=mjoin, box=c_buildingcreation, resolution=panel_5)  # -> bs_base, voxel; disabled
c_voxelbuilding = C_VoxelBuilding(voxel=c_voxelcontext.voxel, resolution=panel_5, building=c_buildingcreation)  # -> bs_buid, bs_bbox; disabled
c_voxelboolean = C_VoxelBoolean(
    bs_base=c_voxelcontext.bs_base,
    voxel=c_voxelcontext.voxel,
    bs_buid=c_voxelbuilding.bs_buid,
    bs_bbox=c_voxelbuilding.bs_bbox)  # -> context, building; disabled

# ----
mjoin_2 = MeshJoin(Meshes=[c_voxelboolean.context, c_voxelboolean.building])  # disabled
panel_11 = Panel("{0, 5, 0}")  # disabled
panel_12 = Panel("(1,3)")  # disabled
panel_13 = Panel("test")  # disabled
panel_14 = Panel("16")  # disabled
panel_15 = Panel("14")  # disabled
c_windsimulation = C_WindSimulation(geometry=mjoin_2, refinement=panel_12, casename=panel_13, windvector=panel_11, cellsize=panel_14, numbercpu=panel_15)  # disabled

# ==== cluster C_WindSimulation
wall = Butterfly_WallBoundary()  # -> wall_boundary; plug-in component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
tunnelparams = Butterfly_WindTunnelParameters(windward_x="1.5", top_x="1.5", sides_x="1.5", leeward_x="3")  # -> report, tunnel_params; plug-in component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
geometry = ClusterInput()
refinement = ClusterInput()
createbfgeometry = Butterfly_CreateButterflyGeometry(name="buildings", geo=flatten(geometry), boundary=wall, refine_levels=refinement)  # -> report, BF_geo; plug-in component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
windvector = ClusterInput()
casename = ClusterInput()
numbercpu = ClusterInput()
createcasefromtunnel = Butterfly_CreateCaseFromTunnel(
    name=casename,
    BF_geo=flatten(createbfgeometry.BF_geo),
    wind_vector=windvector,
    ref_wind_height="10",
    landscape="0.5",
    tunnel_params=tunnelparams.tunnel_params,
    run=Toggle(True))  # -> report, block_pts, case, wind_tunnel; plug-in component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
snappyhexmeshdict = Butterfly_snappyHexMeshDict(
    castellated_mesh=True,
    snap=True,
    add_layers=False,
    n_cells_btwn_levels=3,
    max_global_cells=2000000,
    expansion_ratio=1.1,
    final_layer_thickness=0.7,
    min_thickness=0.1,
    n_layer_iter=50,
    additional_par="CastellatedMeshControl{ResolveFeatureAngle 95; }")  # -> snappy_hex_mesh_dict; plug-in component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
decomposepardict_scotch = Butterfly_decomposeParDictScotch(num_of_cpus=numbercpu)  # -> decompose_par_dict; plug-in component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
cellsize = ClusterInput()
wtgrading = Butterfly_windTunnelGrading(wind_tunnel=createcasefromtunnel.wind_tunnel, cell_size=cellsize, cell_to_cell_ratio=1.2, wake_offset=2, height_offset=5)  # -> report, grad_xyz, cell_count_xyz, cell_count_tot, preview; plug-in component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
loadmesh = Butterfly_LoadMesh(case=createcasefromtunnel.case, inner_mesh=False, load=Toggle(False))  # -> mesh; plug-in component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
blockmesh = Butterfly_blockMesh(
    case=createcasefromtunnel.case,
    grad_xyz=wtgrading.grad_xyz,
    cell_count=wtgrading.cell_count_xyz,
    overwrite=True,
    write=Toggle(True),
    run=Toggle(True))  # -> report, case; plug-in component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
controldict = Butterfly_controlDict(start_time=0, end_time="200", write_interval="20", write_compression=False, purge_write=0)  # -> control_dict; plug-in component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
snappyhexmesh = Butterfly_snappyHexMesh(
    case=blockmesh.case,
    snappy_hex_mesh_dict=snappyhexmeshdict,
    decompose_par_dict=decomposepardict_scotch,
    write=Toggle(True),
    run=Toggle(True))  # -> report, case; plug-in component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
solutionparams = Butterfly_SolutionParameters(control_dict=controldict)  # -> solution_par; plug-in component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
laminar = Butterfly_LaminarTurbulenceModel()  # -> laminar; plug-in component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
steadyincomp = Butterfly_SteadyIncompressibleRecipe(turbulence_prop=laminar)  # -> report, recipe; plug-in component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
solution = Butterfly_Solution(
    case=snappyhexmesh.case,
    recipe=steadyincomp.recipe,
    decompose_par_dict=decomposepardict_scotch,
    solution_par=solutionparams,
    interval="1",
    write=Toggle(True),
    run=Toggle(True))  # -> report, solution, is_running, timestep, residual_fields, residual_values, log_files; plug-in component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

# ==== cluster C_ContextAcquisition
pos_center_x = ClusterInput()
url_geojson = ClusterInput()
pos_center_y = ClusterInput()
radius_bbox = ClusterInput()
python = GhPythonScript(url_geojson=url_geojson, pos_center_x=pos_center_x, pos_center_y=pos_center_y, radius_bbox=radius_bbox)  # -> out, url_tiles
# ---------- python: Python ----------
__author__ = "23100"
__version__ = "2023.09.18"

import rhinoscriptsyntax as rs
import urllib2
import json
import zipfile
import os

# Check if a point is inside the polygon
def is_point_inside_polygon(x, y, polygon):
    n = len(polygon)
    inside = False
    p1x, p1y = polygon[0]
    for i in range(n + 1):
        p2x, p2y = polygon[i % n]
        if y > min(p1y, p2y):
            if y <= max(p1y, p2y):
                if x <= max(p1x, p2x):
                    if p1y != p2y:
                        xinters = (y - p1y) * (p2x - p1x) / (p2y - p1y) + p1x
                    if p1x == p2x or x <= xinters:
                        inside = not inside
        p1x, p1y = p2x, p2y
    return inside

# Check if the two polygons intersect
def polygons_overlap(polygon1, polygon2):
    for x, y in polygon1:
        if is_point_inside_polygon(x, y, polygon2):
            return True
    for x, y in polygon2:
        if is_point_inside_polygon(x, y, polygon1):
            return True
    return False

# imput parameters
center = (pos_center_x, pos_center_y)
url = url_geojson
radius = radius_bbox

# The offsets for bbox
degree = radius / 111000

# The bbox that should be selected
querying_polygon = [(center[0] - degree, center[1] - degree), (center[0] + degree, center[1] - degree),
                    (center[0] + degree, center[1] + degree), (center[0] - degree, center[1] + degree)]

# Request the geojson file that containing the tiles
response = urllib2.urlopen(url)
data = response.read()
geojson = json.loads(data)
features = geojson["features"]

# Get the urls of the tiles that should be downloaded
urls = []
for feature in features:
    coordinates = feature["geometry"]["coordinates"][0][0]
    queried_polygon = [(coordinates[0][0], coordinates[0][1]), (coordinates[1][0], coordinates[1][1]),
                       (coordinates[2][0], coordinates[2][1]), (coordinates[3][0], coordinates[3][1])]
    if polygons_overlap(querying_polygon, queried_polygon):
        urls.append(feature["properties"]["URL_1"])

print len(urls)
out = len(urls)
url_tiles = urls
# ---------- end python ----------
temp_dir = ClusterInput()
tile_count = ClusterOutput(python.out)
python_2 = GhPythonScript(url_tiles=python.url_tiles, temp_dir=temp_dir)  # -> temp_dir; inputs url_tiles: list
# ---------- python_2: Python ----------
__author__ = "23100"
__version__ = "2023.09.18"

import rhinoscriptsyntax as rs
import urllib2
import json
import zipfile
import os

urls = url_tiles

# Create a fold to store temporal files
if not os.path.exists(temp_dir):
    os.makedirs(temp_dir)

for url in urls:
    # Download the zip file (may be overwritten)
    response = urllib2.urlopen(url)
    zip_file_name = os.path.join(temp_dir, "temp_file.zip")
    with open(zip_file_name, 'wb') as zip_file:
        zip_file.write(response.read())
        
    # Extract the obj file
    with zipfile.ZipFile(zip_file_name, "r") as zip_ref:
        for file_name in zip_ref.namelist():
            if file_name.endswith(".obj"):
                with open(os.path.join(temp_dir, file_name), 'wb') as extracted_file:
                    extracted_file.write(zip_ref.read(file_name))
# ---------- end python_2 ----------
python_3 = GhPythonScript(temp_dir=python_2)  # -> meshes
# ---------- python_3: Python ----------
__author__ = "23100"
__version__ = "2023.09.18"

import rhinoscriptsyntax as rs
import os
import Rhino
import math

# Find the names of all the obj files
file_names = os.listdir(temp_dir)
outs = [os.path.join(temp_dir, name) for name in file_names if name.endswith(".obj")]

meshes = []

for out in outs:
    newMesh = Rhino.Geometry.Mesh()
    with open(out, 'r') as obj:
        lines = obj.readlines()
        for line in lines:
            parts = line.split()
            if len(parts) == 0:
                continue
            if parts[0] == 'v':
                # Add vertex
                x, y, z = map(float, parts[1:4])
                newMesh.Vertices.Add(x, y, z)
            elif parts[0] == 'f':
                # Add face
                vertices = [int(v.split('/')[0]) - 1 for v in parts[1:]]
                newMesh.Faces.AddFace(vertices[0], vertices[1], vertices[2])

    # Create the mesh using extracted data
    newMesh.Faces.CullDegenerateFaces()
    newMesh.Vertices.CullUnused()
    meshes.append(newMesh)

print meshes
# ---------- end python_3 ----------
mjoin = MeshJoin(Meshes=python_3)
bbox = BoundingBox(Content=mjoin, Plane=PlaneXY(0, 0, 0))  # -> Box, Box_2
boxprop = BoxProperties(Box=bbox.Box)  # -> Center, Diagonal, Area, Volume, Degeneracy
pdecon = Deconstruct(Point=boxprop.Center)  # -> XComponent, YComponent, ZComponent
vec = VectorXYZ(XComponent=0, YComponent=0, ZComponent=0)  # -> Vector, Length
vec_2 = VectorXYZ(XComponent=pdecon.XComponent, YComponent=pdecon.YComponent, ZComponent=0)  # -> Vector, Length
move2pt = MoveToPoint(Geometry=mjoin, PointA=vec_2.Vector, PointB=vec.Vector)  # -> Moved, Vector, Transform
context = ClusterOutput(move2pt.Moved)

# ==== cluster C_BuildingCreation
movement_x = ClusterInput()
movement_y = ClusterInput()
movement_z = ClusterInput()
vec = VectorXYZ(XComponent=movement_x, YComponent=movement_y, ZComponent=movement_z)  # -> Vector, Length
building = ClusterInput()
move = Move(Geometry=building, Motion=vec.Vector)  # -> Geometry, Transform
building_2 = ClusterOutput(move.Geometry)

# ==== cluster C_VoxelContext
resolution = ClusterInput()
box = ClusterInput()
box_2 = Box(box)
context = ClusterInput()
debox = DeconstructBox(Box=box_2)  # -> Plane, X, Y, Z
box_3 = Box(context)
debox_2 = DeconstructBox(Box=box_3)  # -> Plane, X, Y, Z
dedomain = DeconstructDomain(Domain=debox_2.X)  # -> Start, End
dedomain_2 = DeconstructDomain(Domain=debox.X)  # -> Start, End
dedomain_3 = DeconstructDomain(Domain=debox_2.Y)  # -> Start, End
dedomain_4 = DeconstructDomain(Domain=debox.Y)  # -> Start, End
dedomain_5 = DeconstructDomain(Domain=debox_2.Z)  # -> Start, End
dedomain_6 = DeconstructDomain(Domain=debox.Z)  # -> Start, End
max = Maximum(A=dedomain.End, B=dedomain_2.End)
min = Minimum(A=dedomain.Start, B=dedomain_2.Start)
max_2 = Maximum(A=dedomain_3.End, B=dedomain_4.End)
min_2 = Minimum(A=dedomain_3.Start, B=dedomain_4.Start)
max_3 = Maximum(A=dedomain_5.End, B=dedomain_6.End)
min_3 = Minimum(A=dedomain_5.Start, B=dedomain_6.Start)
dom = ConstructDomain(DomainStart=min, DomainEnd=max)
dom_2 = ConstructDomain(DomainStart=min_2, DomainEnd=max_2)
dom_3 = ConstructDomain(DomainStart=min_3, DomainEnd=max_3)
box_4 = DomainBox(Base=debox_2.Plane, X=dom, Y=dom_2, Z=dom_3)
voxcreate = CreateVoxelGrid(BoundingBox=box_4, SizeX=resolution, SizeY=resolution, SizeZ=resolution)
voxel = ClusterOutput(voxcreate)
voxgeo = VoxelateGeometry(Geometry=context, VoxelGrid=voxcreate, Distance=resolution)
vgdimensions = VoxelGridDimensions(Grids=voxcreate)  # -> Voxelsize, Voxelcount
pdecon = Deconstruct(Point=vgdimensions.Voxelcount)  # -> XComponent, YComponent, ZComponent
vglist = VoxelGridToList(Grids=voxgeo)  # -> Bool, Pts
c_script = CSharpScript(xn=pdecon.XComponent, yn=pdecon.YComponent, zn=pdecon.ZComponent, bs=vglist.Bool)  # -> bsBase; inputs xn: Int32, yn: Int32, zn: Int32, bs: list of Boolean
# ---------- c_script: C# ----------
    HashSet<int> skyIds = new HashSet<int>();
    Queue<int> nexIds = new Queue<int>();

    int id = 0; // Initialize id here

    for (int i = 0; i < xn * yn; i++)
    {
      id = zn * (i + 1) - 1;
      if (!bs[id])
      {
        break;
      }
    }

    bs[id] = true;
    nexIds.Enqueue(id);
    skyIds.Add(id);

    while (nexIds.Count > 0)
    {
      id = nexIds.Dequeue();
      int x = id / (yn * zn);
      int y = (id / zn) % yn;
      int z = id % zn;
      int[][] neis = new int[][]
        {
        new int[] { x, y, z - 1 },
        new int[] { x, y, z + 1 },
        new int[] { x, y - 1, z },
        new int[] { x, y + 1, z },
        new int[] { x - 1, y, z },
        new int[] { x + 1, y, z }
        };

      foreach (var nei in neis)
      {
        int nx = nei[0];
        int ny = nei[1];
        int nz = nei[2];
        if (IsValid(nx, ny, nz, xn, yn, zn))
        {
          int neiId = nx * yn * zn + ny * zn + nz;
          if (!bs[neiId])
          {
            bs[neiId] = true;
            nexIds.Enqueue(neiId);
            skyIds.Add(neiId);
          }
        }
      }
    }

    List<bool> bs_Base = new List<bool>(xn * yn * zn);

    for (int i = 0; i < xn * yn * zn; i++)
    {
      bs_Base.Add(!skyIds.Contains(i));
    }

    // Output bsBase using the ref object parameter
    bsBase = bs_Base;
# ---------- c_script: C# additional code ----------
  static bool IsValid(int x, int y, int z, int xn, int yn, int zn){
    return 0 <= x && x < xn && 0 <= y && y < yn && 0 <= z && z < zn;
  }
# ---------- end c_script ----------
bs_base = ClusterOutput(c_script)

# ==== cluster C_VoxelBuilding
resolution = ClusterInput()
building = ClusterInput()
voxel = ClusterInput()
box = Box(building)
voxgeo = VoxelateGeometry(Geometry=building, VoxelGrid=voxel, Distance=resolution)
voxgeo_2 = VoxelateGeometry(Geometry=box, VoxelGrid=voxel, Distance=resolution)
vglist = VoxelGridToList(Grids=voxgeo)  # -> Bs_buid, Pts
vglist_2 = VoxelGridToList(Grids=voxgeo_2)  # -> Bs_bbox, Pts
bs_buid = ClusterOutput(vglist.Bs_buid)
bs_bbox = ClusterOutput(vglist_2.Bs_bbox)

# ==== cluster C_VoxelBoolean
bs_base = ClusterInput()
bs_bbox = ClusterInput()
voxel = ClusterInput()
c_script = CSharpScript(bs_base=bs_base, bs_bbox=bs_bbox)  # -> bsClip; inputs bs_base: list of Boolean, bs_bbox: list of Boolean
# ---------- c_script: C# ----------
    int length = bs_base.Count;
    bool[] bs_clip = new bool[length];

    for (int id = 0; id < length; id++)
    {
      bs_clip[id] = (bs_base[id] == true && bs_bbox[id] == false) ? true : false;
    }
    bsClip = bs_clip;
# ---------- end c_script ----------
bs_buid = ClusterInput()
vglist = VoxelGridFromList(Grid=voxel, Bool=c_script)
vglist_2 = VoxelGridFromList(Grid=voxel, Bool=bs_buid)
building = ClusterOutput(vglist_2)
context = ClusterOutput(vglist)
