# Grasshopper definition loadSpain.gh (Grasshopper 1.0.7)
# Copyright: RHDHV 2021

# ---- group: Location parameters
# Plot bbox
region_bbox_side = Slider(1000, range=0..1000)
number_slider = Slider(0, range=0..100)
panel = Panel("""Madrid point
441328.33
4477551.61""")
path = FilePath(["C:\Users\seren\Documents\tudelft\geomatics\geo1101Synthesis\spain\data\MDT02-ETRS89-HU30-0559-1-COB2.asc", "C:\Users\seren\Documents\tudelft\geomatics\geo1101Synthesis\spain\data\MDT02-ETRS89-HU30-0559-2-COB2.asc"])
path_2 = FilePath("C:\Users\seren\Documents\tudelft\geomatics\geo1101Synthesis\spain\data\NDSM-Edificacion-ETRS89-H30-0559-COB1.asc")
num = Number("441328.33")
num_2 = Number("4477551.61")
bouding_box_plot = Geometry(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)

# ---- group: tower / Levels per group
number_slider_2 = Slider(2, range=1..10)
number_slider_3 = Slider(3, range=1..10)
number_slider_4 = Slider(1, range=1..10)
number_slider_5 = Slider(3, range=1..10)
number_slider_6 = Slider(4, range=1..10)
number_slider_7 = Slider(5, range=1..10)

# ---- group: tower
level_height = Slider(3.8, range=0..10)
entwine = Entwine(
    Branch00=number_slider_2,
    Branch01=number_slider_3,
    Branch02=number_slider_5,
    Branch03=number_slider_6,
    Branch04=number_slider_4,
    Branch05=number_slider_7,
    FlattenInputs=True)
level_height_2 = Number(level_height)
levels = Number(flatten(entwine))
building_footrprints = Curve([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])
parametric_building = Parametric_building(footrprints=building_footrprints, levels=levels, level_height=level_height_2)  # -> solids_2, one_solid_volume_2, facade_faces_2, single__level_volumes_2
brep = Brep(parametric_building.solids_2)

# ----
cluster = Cluster(
    dtm_terrain_files=path,
    los=number_slider,
    dsm_terrain_files=path_2,
    plot=bouding_box_plot,
    x_coordinate=num,
    y_coordinate=num_2,
    terrain_length=region_bbox_side)  # -> terrain_mesh, center_point, context, buildings

# ---- group: Visualise
swatch = ColourSwatch(SwatchColor=RGB(255, 255, 255))
preview = CustomPreview(Geometry=cluster.terrain_mesh, Material=swatch)
preview_2 = CustomPreview(Geometry=cluster.buildings, Material=swatch)
preview_3 = CustomPreview(Geometry=brep, Material=ColourSwatch(SwatchColor=RGB(209, 209, 209)))

# ----
project_center_point_on_terrain = ProjectCenterPointOnTerrain(pt=cluster.center_point, mesh=cluster.terrain_mesh)

# ---- group: Solar analysis
number_slider_8 = Slider(2, range=0..100)
number_slider_9 = Slider(3, range=0..10)
epw_url = Panel("https://climate.onebuilding.org/WMO_Region_6_Europe/ESP_Spain/MD_Madrid/ESP_MD_Madrid.WS.082200_TMYx.zip")
month = Panel("12")
day = Panel("21")

# ---- group: Solar analysis / Geometries
geometry = Geometry(cluster.context)
context = Geometry(brep)

# ----
weather_information = WeatherInformation(start_month=month, start_day=day, end_month=month, end_day=day, weather_url=epw_url)  # -> hoys, location, direct_normal_rad, diffuse_horizontal_rad
shadow_analysis = ShadowAnalysis(
    geometry=geometry,
    context=context,
    grid_size=number_slider_9,
    offset_dist=number_slider_8,
    location=weather_information.location,
    hoys=weather_information.hoys,
    center_pt=project_center_point_on_terrain)  # disabled
irradiation_analysis = IrradiationAnalysis(
    geometry=context,
    context=geometry,
    grid_size=number_slider_9,
    offset_dist=number_slider_8,
    location=weather_information.location,
    direct_rad=weather_information.direct_normal_rad,
    diffuse_rad=weather_information.diffuse_horizontal_rad,
    hoys=weather_information.hoys)  # disabled

# ==== cluster Parametric_building
footrprints = ClusterInput()
level_height = ClusterInput()
levels = ClusterInput()
footrprints_2 = Curve(footrprints)
level_height_2 = Number(level_height)
levels_2 = Number(levels)

# ---- group: Building
level_height_3 = Number(level_height_2)
levels_3 = Number(levels_2)
footrprints_3 = Curve(footrprints_2)
expression = Expression(levels=levels_3, height=level_height_3, Expression="levels * height")
ma = MassAddition(Input=expression)  # -> Result, PartialResults
level_height_4 = Number(level_height_2)
Z = UnitZ(Factor=expression)
Z_2 = UnitZ(Factor=level_height_4)
levels_4 = Number(levels_2)

# ----
subtraction = Subtraction(A=ma.PartialResults, B=expression)

# ---- group: Building (continued)
Z_3 = UnitZ(Factor=subtraction)
move = Move(Geometry=footrprints_3, Motion=Z_3)  # -> Geometry, Transform
boundary = BoundarySurfaces(Edges=move.Geometry)  # -> flatten(Surfaces)
srf = Surface(move.Geometry)
arrlinear = LinearArray(Geometry=boundary, Direction=Z_2, Count=levels_4)  # -> Geometry, Transform
extr = Extrude(Base=move.Geometry, Direction=Z)
extr_2 = Extrude(Base=srf, Direction=Z)
sunion = SolidUnion(Breps=extr_2)
extr_3 = Extrude(Base=arrlinear.Geometry, Direction=Z_2)
footprints_groups = Curve(move.Geometry)
facade_faces = Brep(extr)
one_solid_volume = Brep(sunion)
single__level_volumes = Brep(extr_3)

# ----
solids = Brep(extr_2)
one_solid_volume_2 = ClusterOutput(one_solid_volume)
solids_2 = ClusterOutput(solids)
single__level_volumes_2 = ClusterOutput(single__level_volumes)
facade_faces_2 = ClusterOutput(facade_faces)

# ==== cluster WeatherInformation

start_month = ClusterInput()
start_day = ClusterInput()
end_month = ClusterInput()
end_day = ClusterInput()
weather_url = ClusterInput()

# ---- group: location
downloadepw = LBDownloadWeather(weather_URL=weather_url)  # -> epw_file, stat_file, ddy_file; plug-in component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
importepw = LBImportEPW(epw_file=downloadepw.epw_file)  # -> location, dry_bulb_temperature, dew_point_temperature, relative_humidity, wind_speed, wind_direction, direct_normal_rad, diffuse_horizontal_rad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; plug-in component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
importloc = LBImportLocation(epw_file=downloadepw.epw_file)  # -> location; plug-in component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

# ---- group: day
analysisperiod = LBAnalysisPeriod(start_month=start_month, start_day=start_day, start_hour=0, end_month=end_month, end_day=end_day)  # -> period, hoys, dates; plug-in component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

# ----
hoys = ClusterOutput(analysisperiod.hoys)
location = ClusterOutput(importloc)
direct_normal_rad = ClusterOutput(importepw.direct_normal_rad)
diffuse_horizontal_rad = ClusterOutput(importepw.diffuse_horizontal_rad)

# ==== cluster IrradiationAnalysis
geometry = ClusterInput()
context = ClusterInput()
grid_size = ClusterInput()
offset_dist = ClusterInput()
location = ClusterInput()
direct_rad = ClusterInput()
diffuse_rad = ClusterInput()
hoys = ClusterInput()

# ---- group: irradiation
skymatrix = LBCumulativeSkyMatrix(location=location, direct_rad=direct_rad, diffuse_rad=diffuse_rad, hoys=hoys)  # -> report, sky_mtx; plug-in component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
incidentradiation = LBIncidentRadiation(
    sky_mtx=skymatrix.sky_mtx,
    geometry=flatten(geometry),
    context=flatten(context),
    grid_size=grid_size,
    offset_dist=offset_dist,
    run=Toggle(True))  # -> report, points, results, total, mesh, legend, title, int_mtx; plug-in component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

# ==== cluster ShadowAnalysis
geometry = ClusterInput()
context = ClusterInput()
grid_size = ClusterInput()
offset_dist = ClusterInput()
location = ClusterInput()
hoys = ClusterInput()
center_pt = ClusterInput()
sunpath = LBSunPath(location=location, hoys=hoys, center_pt=center_pt, scale=Slider(10, range=0..10))  # -> report, vectors, altitudes, azimuths, hoys, sun_pts, analemma, daily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; plug-in component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
directsunhours = LBDirectSunHours(
    vectors=flatten(sunpath.vectors),
    geometry=flatten(geometry),
    context=flatten(context),
    grid_size=grid_size,
    offset_dist=offset_dist,
    run=Toggle(True))  # -> report, points, results, mesh, legend, title, int_mtx; plug-in component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

# ==== cluster Cluster
terrain_length = ClusterInput()
dtm_terrain_files = ClusterInput()
dsm_terrain_files = ClusterInput()
los = ClusterInput()
plot = ClusterInput()
x_coordinate = ClusterInput()
y_coordinate = ClusterInput()
dom = Domain(DomainStart=expr("-x/2", terrain_length), DomainEnd=expr("x/2", terrain_length))
pt = ConstructPoint(XCoordinate=x_coordinate, YCoordinate=y_coordinate, ZCoordinate=0)
dom_2 = Domain(DomainStart=expr("-x/2", terrain_length), DomainEnd=expr("x/2", terrain_length))
rectangle = Rectangle(Plane=pt, XSize=dom, YSize=dom_2, Radius=0)  # -> Rectangle, Length
box_corners = BoxCorners(Box=rectangle.Rectangle)  # -> CornerA, CornerB, CornerC, CornerD, CornerE, CornerF, CornerG, CornerH
extract_points_from_esri_grid = ExtractPointsFromEsriGrid(file_in=dsm_terrain_files, los=los, region=rectangle.Rectangle, plot=plot)  # -> pts, plot_pts

# ---- group: Terrain
cluster = ExtractPointsFromEsriGrid(file_in=dtm_terrain_files, los=los, region=rectangle.Rectangle)  # -> pts, plot_pts
xy = XYPlane(Origin=Point(0, 0, 0))
cullpt = CullDuplicates(Points=cluster.pts, Tolerance=0.1, CullMode=3)  # -> Points, Indices, Valence
del = DelaunayMesh(Points=cullpt.Points, Plane=xy)

# ---- group: remove duplicates
python = GhPythonScript(heights=extract_points_from_esri_grid.pts, minimum=box_corners.CornerA, maximum=box_corners.CornerG)  # -> out, buildings; inputs heights: list of Point3d, minimum: Point3d, maximum: Point3d
# ---------- python: Python ----------
import rhinoscriptsyntax as rs
import xml.etree.ElementTree as ET
from System.Net import *
from System.IO import StreamReader
import ghpythonlib.treehelpers as th
import Rhino
import math
import functools

def percentile(N, percent, key=lambda x:x):
    """
    Find the percentile of a list of values.

    @parameter N - is a list of values. Note N MUST BE already sorted.
    @parameter percent - a float value from 0.0 to 1.0.
    @parameter key - optional key function to compute value from each element of N.

    @return - the percentile of the values
    
    from https://stackoverflow.com/questions/2374640/how-do-i-calculate-percentiles-with-python-numpy
    """
    if not N:
        return None
    k = (len(N)-1) * percent
    f = math.floor(k)
    c = math.ceil(k)
    if f == c:
        return key(N[int(k)])
    d0 = key(N[int(f)]) * (c-k)
    d1 = key(N[int(c)]) * (k-f)
    return d0+d1


def convert_list_to_string(org_list, seperator=','):
    """ Convert list to string, by joining all item in list with given separator.
        Returns the concatenated string """
    return seperator.join(org_list)

def chunks(l, n):
    #break the list "l" into sub-lists each has the length of "n"
    n = max(1, n)
    return [l[i:i + n] for i in range(0, len(l), n)]


ns_gml="http://www.opengis.net/gml/3.2"
bu_core="http://inspire.jrc.ec.europa.eu/schemas/bu-core2d/2.0"

b = str(int(minimum.X)) + "," + str(int(minimum.Y)) + "," + str(int(maximum.X)) + "," + str(int(maximum.Y))
url = "http://ovc.catastro.meh.es/INSPIRE/wfsBU.aspx?service=wfs&request=getfeature&typenames=BU.BUILDING&bbox=" + b + "&srsname=EPSG::25830"

req = HttpWebRequest.Create(url)
req.Method = "GET"

rsp = req.GetResponse()
streamReader = StreamReader(rsp.GetResponseStream())
XMLData = streamReader.ReadToEnd()
root = ET.fromstring(XMLData)
buildings = []
ids = []
for member in root.iter('{%s}featureMember' % ns_gml):
    for geom in member.findall('.//{%s}geometry' % bu_core):
        for patch in geom.findall('.//{%s}PolygonPatch' % ns_gml):
            tmplines = []
            plot_heights = []
            for poslist in member.findall('.//{%s}posList' %ns_gml):
                 
                points_list = [float(val) for val in (poslist.text).strip().split(' ')]
                
                points_list_chunks = chunks(points_list,2)
                
                building_pline = rs.AddPolyline(points_list_chunks)
                if len(tmplines) == 0:
                    for i in heights:
                        if rs.PointInPlanarClosedCurve(i,building_pline,rs.WorldXYPlane()) == 1:
                            plot_heights.append(i.Z)
                tmplines.append(rs.coercecurve(building_pline))
            ext_srf = Rhino.Geometry.Brep.CreatePlanarBreps(tmplines)[0]
            
            height_z = max(0,percentile(plot_heights, percent=0.95))
            if height_z > 0:
                height = rs.AddLine((0,0,0), (0,0,height_z+3))
                block = rs.ExtrudeSurface(ext_srf, height)

                buildings.append(block)
# ---------- end python ----------
volume = Volume(Geometry=python.buildings)  # -> Volume, Centroid
python_2 = GhPythonScript(volumes=volume.Volume, centroids=volume.Centroid)  # -> out, remove; inputs volumes: list, centroids: list
# ---------- python_2: Python ----------
__author__ = "serenic"
__version__ = "2023.10.26"

import rhinoscriptsyntax as rs
indices = []
remove = []
for vol_i in range(len(volumes)-1):
    ind = []
    for vol_j in range(vol_i+1, len(volumes)):
        if volumes[vol_i] == volumes[vol_j]:
            ind.append(vol_j)
    indices.append(ind)
for centroids_i in range(len(indices)):
    for index in indices[centroids_i]:
        if rs.PointCompare(centroids[centroids_i], centroids[index]):
            if index not in remove: remove.append(index)
print remove
# ---------- end python_2 ----------
cull_i = CullIndex(List=python.buildings, Indices=python_2.remove, Wrap=True)

# ----
project_buildings_on_mesh = ProjectBuildingsOnMesh(geometry=cull_i, terrain_mesh=del, centerpoint=pt)  # -> G, V
clean = CleanTree(RemoveNulls=True, RemoveInvalid=True, RemoveEmpty=False, Tree=project_buildings_on_mesh.G)
entwine = Entwine(Branch00=del, Branch01=clean, FlattenInputs=True)  # -> flatten(Result)
terrain_mesh = ClusterOutput(del)
center_point = ClusterOutput(pt)
buildings = ClusterOutput(clean)
context = ClusterOutput(entwine)

# ==== cluster ProjectCenterPointOnTerrain
pt = ClusterInput()
mesh = ClusterInput()
Z = UnitZ(Factor=1)
pt_2 = Point(pt)
mesh_2 = Mesh(mesh)
project = ProjectPoint(Point=pt_2, Direction=Z, Geometry=mesh_2)  # -> Point, Index
P = ClusterOutput(project.Point)

# ==== cluster ExtractPointsFromEsriGrid
region = ClusterInput()
plot = ClusterInput()
los = ClusterInput()
file_in = ClusterInput()
python = GhPythonScript(file_in=file_in, LoS=los, region=region, plot=plot)  # -> out, pts, plot_pts; inputs file_in: list, region: Rectangle3d, plot: Rectangle3d
# ---------- python: Python ----------
__author__ = "serenic"
__version__ = "2023.09.16"

import rhinoscriptsyntax as rs
from math import sqrt
pts = []
plot_pts= []
if plot:
    xs = []
    ys = []
    corners = plot.BoundingBox.GetCorners()
    for i in corners:
        xs.append(i.X)
        ys.append(i.Y)
    minx_plot = min(xs)
    maxx_plot = max(xs)
    miny_plot = min(ys)
    maxy_plot = max(ys)
    
if region:
    xs = []
    ys = []
    corners = region.BoundingBox.GetCorners()
    for i in corners:
        xs.append(i.X)
        ys.append(i.Y)
    minx_region = min(xs)
    maxx_region = max(xs)
    miny_region = min(ys)
    maxy_region = max(ys)

if file_in:
    if not(type(file_in) is list):
        file_in =[file_in]
    for f_in in file_in:
        # Read file
        file = open(f_in, 'r')
        
    #    ncols         7167
    #    nrows         4727
    #    xllcenter     441476
    #    yllcenter     4455580
    #    cellsize      2
    #    nodata_value  -9999.0
    
        ncols = int(file.readline().split(' ')[-1].strip())
        nrows = int(file.readline().split(' ')[-1].strip())
        xllline = file.readline().split(' ')
        yllline = file.readline().split(' ')
        cellsize = float(file.readline().split(' ')[-1].strip())
        nodata_valueline = file.readline().split(' ')
        
        lines = file.readlines()
        file.close()
        
        
        if 'corner' in xllline[0]:
            xllcenter = float(xllline[-1].strip()) + 0.5*cellsize
        else:
            xllcenter = float(xllline[-1].strip())
        
        if 'corner' in yllline[0]:
            yllcenter = float(yllline[-1].strip()) + 0.5*cellsize
        else:
            yllcenter =float(yllline[-1].strip())
        
        if 'nodata' in nodata_valueline[0]:
            nodata_value = float(nodata_valueline[-1].strip())
        else:
            nodata_value = -9999
            nodata_valueline.extend(lines)
            lines = nodata_valueline
        
        
    #    xyz = file.readlines()
        
        values = []
        for line in lines:
            values.extend(line.strip().split(' '))
    #    
        # Check for input variables
        if not LoS:
            LoS = 20
        elif LoS == 0:
            LoS = 1
        else:
            LoS = int(LoS)
        
    #    indices = [i for i in range(nrows * ncols) if i % LoS == 0]
        indices = range(0,nrows * ncols,LoS)
        for i in indices:
            if float(values[i]) != nodata_value: 
                y = ((nrows - (i // ncols)) * cellsize) + yllcenter
                x = ((i % ncols) * cellsize) + xllcenter
                z = values[i]
                pt = rs.AddPoint([x,y,z])
                if region:
                    if minx_region < x and x < maxx_region and miny_region < y and y < maxy_region:
                        if plot:
                            if not(minx_plot < x and x < maxx_plot and miny_plot < y and y < maxy_plot):
#                    if rs.PointInPlanarClosedCurve(pt,region,rs.WorldXYPlane()) == 1:
                                pts.append(pt)
                            else:
                                plot_pts.append(pt)
                        else:
                            pts.append(pt)
                else:
                    pts.append(pt)
# ---------- end python ----------
pts = ClusterOutput(python.pts)
plot_pts = ClusterOutput(python.plot_pts)

# ==== cluster ProjectBuildingsOnMesh
terrain_mesh = ClusterInput()
centerpoint = ClusterInput()
geometry = ClusterInput()
geometry_2 = Geometry(geometry)
centerpoint_2 = Point(centerpoint)
num = Number(3)
num_2 = Number(0)
xy = XYPlane(Origin=centerpoint_2)
amoments = AreaMoments(Geometry=geometry_2)  # -> Area, Centroid, Inertia, InertiaError, Secondary, SecondaryError, Gyration
Z = UnitZ(Factor=1)
vec = VectorXYZ(XComponent=num_2, YComponent=num_2, ZComponent=num)  # -> Vector, Length
move = Move(Geometry=xy, Motion=vec.Vector)  # -> Geometry, Transform
project = Project(Geometry=amoments.Centroid, Plane=move.Geometry)  # -> Geometry, Transform
project_2 = ProjectPoint(Point=amoments.Centroid, Direction=Z, Geometry=terrain_mesh)  # -> Point, Index
vec2pt = Vector2Pt(PointA=project.Geometry, PointB=project_2.Point, Unitize=False)  # -> Vector, Length
move_2 = Move(Geometry=geometry_2, Motion=vec2pt.Vector)  # -> Geometry, Transform
G = ClusterOutput(move_2.Geometry)
V = ClusterOutput(Z)
